vi "index.gviweb"   [LabVIEW NXG 5.1.0]
panel controls:
  "Power Button": bool
panel indicators:
  "value": bool
  "Chart": i32
  "LED": bool
diagram:
  # Place setup code before the loop. For example, perform initial data communication and wire the results into the loop.
  # Top-Level WebVIs usually contain a While Loop that never stops so that they can continue running as long as the web page is open in the user's web browser.
  s1 = FALSE  # shift register
  while (iteration -> i1) {
    Not(x=s1) -> w1
    Quotient And Remainder(x=i1, y=20) -> (x-y*floor(x/y)=w2)
    Is Equal To 0(x=w2) -> w3
    Select(s=w3, t=w1, f=s1) -> w4
    $value <- w4
    $Chart <- w2
    Wait(time to wait=50)
    $LED <- $"Power Button"
    next s1 = w4
    stop if FALSE
  }
